# Dynamo graph simpletest.dyn (Dynamo 0.7.2.7096)

byCoordinates = Point.ByCoordinates()
double_slider = DoubleSlider(47.11881675, range=0..100)
double_slider_2 = DoubleSlider(57.672, range=0..100)
byCoordinates_2 = Point.ByCoordinates(double_slider, double_slider_2)
code_block = CodeBlock { "test"; }
integer_slider = IntegerSlider(0, range=0..100)
double_slider_3 = DoubleSlider(41.123, range=0..100)
fromEndPoints = DynamoSAP.Structure.Frame.FromEndPoints(byCoordinates, byCoordinates_2, code_block, code_block, integer_slider, double_slider_3)
baseCurve = DynamoSAP.Structure.Frame.BaseCurve(fromEndPoints)
createSAPModel = DynamoSAP.Assembly.SAPModel.CreateSAPModel(fromEndPoints)
